# Dynamo graph dynamo_script_coordinates_export.dyn (Dynamo 3.3.0.6316)

python_script = Python()  # CPython3; unwired: IN[0]
# ---------- python_script.python (40 lines) ----------
# Load the Python Standard and DesignScript Libraries
import sys
import clr
clr.AddReference('ProtoGeometry')
from Autodesk.DesignScript.Geometry import *

import clr
clr.AddReference('RevitServices')
from RevitServices.Persistence import DocumentManager

clr.AddReference('RevitAPI')
clr.AddReference('RevitNodes')
import Autodesk
from Autodesk.Revit.DB import FilteredElementCollector, BuiltInCategory, Category, ElementId

# Get the active Revit document
doc = DocumentManager.Instance.CurrentDBDocument

# Get all categories in the document
categories = doc.Settings.Categories

# Initialize lists for storing data
element_ids = []
element_categories = []

# Loop through all categories and collect elements
for cat in categories:
    if cat.CategoryType == Autodesk.Revit.DB.CategoryType.Model:  # Only consider model categories
        try:
            # Collect all elements in the current category
            collector = FilteredElementCollector(doc).OfCategoryId(cat.Id).WhereElementIsNotElementType().ToElements()
            
            for elem in collector:
                element_ids.append(elem.Id.IntegerValue)  # Get the element ID
                element_categories.append(cat.Name)  # Get category name
        except:
            pass  # Skip categories that can't be filtered this way

# Output results
OUT = element_ids, element_categories
# ----------------------------------------
file_path = Filename("No file selected.")
code_block = CodeBlock { "Sheet1"; 0; 0; }
python_script_2 = Python()  # CPython3; unwired: IN[0]
# ---------- python_script_2.python (91 lines) ----------
# Load the Python Standard and DesignScript Libraries
import sys
import clr
clr.AddReference('ProtoGeometry')
from Autodesk.DesignScript.Geometry import *

import clr
clr.AddReference('RevitServices')
from RevitServices.Persistence import DocumentManager

clr.AddReference('RevitAPI')
clr.AddReference('RevitNodes')
import Autodesk
from Autodesk.Revit.DB import FilteredElementCollector, ElementId, Parameter

# Get the active Revit document
doc = DocumentManager.Instance.CurrentDBDocument

# Define categories to exclude
excluded_categories = ["Air Terminals", "Sketch", "Area Base Load", "Area Schemes", "Rooms", "Spaces"]

# Initialize lists for storing data
data = []

# Define column headers
headers = ["Element ID", "Category", "Element Name", "Element Length", "System Abbreviation", 
           "System Classification", "Building Location MTI", "Element Level", "Element Type"]
data.append(headers)  # First row: column headers

# Collect all model elements
collector = FilteredElementCollector(doc).WhereElementIsNotElementType().ToElements()

# Function to safely get parameter value
def get_param_value(element, param_name):
    param = element.LookupParameter(param_name)
    if param and param.HasValue:
        return param.AsString() if param.StorageType == Autodesk.Revit.DB.StorageType.String else param.AsValueString()
    return "N/A"

# Function to get element type robustly
def get_element_type(element):
    element_type = get_param_value(element, "Type Name")
    if element_type == "N/A":
        element_type = get_param_value(element, "Family Name")
    if element_type == "N/A":
        try:
            element_type = doc.GetElement(element.GetTypeId()).Name  # Get actual type name
        except:
            element_type = "Unknown Type"
    return element_type

# Loop through elements and extract properties
for elem in collector:
    if not elem.Category or elem.Category.Name in excluded_categories:
        continue  # Skip elements with no category or unwanted categories
    
    row = []  # Each element will be stored as a row
    
    # Get Element ID and Category
    row.append(elem.Id.IntegerValue)
    row.append(elem.Category.Name)

    # Get Element Name (fallback to Family and Type if Name is missing)
    name = get_param_value(elem, "Name")
    if name == "N/A":
        name = get_param_value(elem, "Family and Type")
    row.append(name)

    # Get Element Length (if applicable)
    row.append(get_param_value(elem, "Length"))

    # Get System Abbreviation (for MEP elements)
    row.append(get_param_value(elem, "System Abbreviation"))

    # Get System Classification (New)
    row.append(get_param_value(elem, "System Classification"))

    # Get Building Location MTI (New)
    row.append(get_param_value(elem, "Building Location MTI"))

    # Get Element Level (if applicable)
    row.append(get_param_value(elem, "Level"))

    # Get Element Type (using improved method)
    row.append(get_element_type(elem))

    # Add row to data list
    data.append(row)

# Output the final formatted list for Excel
OUT = data
# ----------------------------------------
exportToExcel = Data.ExportToExcel(filePath=file_path, sheetName=code_block.out0, startRow=code_block.out1, startColumn=code_block.out2, data=python_script_2)
